# Grasshopper definition test_read_config.ghx (Grasshopper 1.0.7)

config_firebase = GhPythonScript()  # -> config
# ---------- config_firebase: Python ----------
import os
import json

if not filename:
    canvas = ghenv.Component.OnPingDocument()
    folder = os.path.dirname(canvas.FilePath)
    filename = os.path.join(folder, "firebase_config.json")

if not os.path.exists(filename):
    raise Exception("Configuration file not found: {}".format(filename))


with open(filename, "r") as f:
    config = json.load(f)
# ---------- end config_firebase ----------
init_to_firebase = GhPythonScript(X=config_firebase)  # -> Out, A

# ---- group: Inputs
height = Slider(0.8, range=0.1..5)
length = Slider(11.67, range=0.1..12)
density = Slider(11, range=1..30)
# Python, single script version
line = Line(StartPoint=Point(13.9137459, 0.4059461094, 0), EndPoint=Point(13.9137459, 22.38502832, 0))

# ---- group: Loft a surface from a single curve + parameters
loft_1_curve = GhPythonScript(curve=line, count=density, height=height, length=length)  # -> curves, points; inputs curve: Line
# ---------- loft_1_curve: Python ----------
from compas.geometry import Translation, Point, NurbsCurve
from compas_rhino.conversions import RhinoPolyline
import Rhino.Geometry as rg


# Divide curve
c = RhinoPolyline.from_geometry(curve).to_compas()
divisions = c.divide(count)

# Move every second point up and build a new list with all points
points = []

for i, point in enumerate(divisions):
    if i % 2 == 1:
        points.append(point)
    else:
        moved_point = Point(point.x, point.y, point.z + height)
        points.append(moved_point)


# Create interpolated curves
curve = NurbsCurve.from_interpolation(points)

# Move second curve
translation = Translation.from_vector([length, 0, 0])
moved_curve = curve.transformed(translation)

curves = [curve, moved_curve]
# ---------- end loft_1_curve ----------

# ----
draw = Draw(cg=loft_1_curve.curves)  # -> rg
#   port cg: The COMPAS geometry or datastructure to be drawn.
#   port rg: The Rhino geometry object.
# ---------- draw: Python ----------
"""
Draws COMPAS geometry in Grasshopper.
"""
from ghpythonlib.componentbase import executingcomponent as component

from compas.artists import Artist


class CompasToRhinoGeometry(component):
    def RunScript(self, cg):
        if not cg:
            return None

        return Artist(cg).draw()
# ---------- end draw ----------
draw_2 = Draw(cg=loft_1_curve.points)  # -> rg; same code as draw

# ---- group: Loft the two curves to create a surface
loft = Loft(Curves=draw, Options={Adjust=False, Closed=False, LoftEnds=0, LoftSimp=0, LoftType=0, Rebuild=10, Refit=0.01})

# ----
surface = Data(loft)
